# Grasshopper definition communication_test_00.gh (Grasshopper 1.0.8)

panel = Panel("{\"command\":\"forward\",\"payload\":{\"command\":\"get_status\",\"job_id\":\"862623f2-a384-43f4-99bf-61f6c8c0335b\"}}")

panel_2 = Panel("base")
panel_3 = Panel("1")
panel_5 = Panel("all")
panel_6 = Panel("eye_to_base")
panel_7 = Panel("2")
panel_8 = Panel("8")

# ---- group: Capture & Transform
connect = BooleanToggle(False)
capture = Button()
transform = Button()
capture_index = ValueList({"1", "2", "3", "4", "5"}, selected="2")
mode = ValueList({"pointcloud", "image", "depth", "all"}, selected="all")
pipeline = ValueList({"base", "ref_cam", "eye_to_base"}, selected="eye_to_base")
eye_to_base_index = ValueList({"1", "2", "3"}, selected="1")
reference_index = ValueList({"1", "2", "3"}, selected="2")
output_index = ValueList({"1", "2", "3", "4", "5", "6", "7", "8", "9", "10"}, selected="2")
refresh_status = BooleanToggle(False)
panel_9 = Panel("RT_Test_00")
c_script = CSharpScript(
    ConnectButton=connect,
    CaptureButton=capture,
    TransformButton=transform,
    SessionName=panel_9,
    CaptureIndex=capture_index,
    Mode=mode,
    Pipeline=pipeline,
    EyeToBaseIndex=eye_to_base_index,
    ReferenceIndex=reference_index,
    OutputIndex=output_index,
    RefreshStatus=refresh_status)  # -> Status, Message; inputs ConnectButton: Boolean, CaptureButton: Boolean, TransformButton: Boolean, SessionName: String, CaptureIndex: Int32, Mode: String, Pipeline: String, EyeToBaseIndex: Int32, ReferenceIndex: Int32, OutputIndex: Int32, RefreshStatus: Boolean
# ---------- c_script: C# ----------
// Grasshopper Script Instance
#region Usings
using System;
using System.Text;
using System.Net.Sockets;
using System.Linq;
using System.Collections;
using System.Collections.Generic;
using System.Drawing;

using Rhino;
using Rhino.Geometry;

using Grasshopper;
using Grasshopper.Kernel;
using Grasshopper.Kernel.Data;
using Grasshopper.Kernel.Types;
#endregion

public class Script_Instance : GH_ScriptInstance
{
    private bool previousCaptureButton = false;
    private bool previousTransformButton = false;

    private bool isConnected = false;
    private bool triedConnect = false;

    private string lastStatus = "Disconnected";
    private string lastMessage = "Click Connect first.";

    private void RunScript(
		bool ConnectButton,
		bool CaptureButton,
		bool TransformButton,
		string SessionName,
		int CaptureIndex,
		string Mode,
		string Pipeline,
		int EyeToBaseIndex,
		int ReferenceIndex,
		int OutputIndex,
		bool RefreshStatus,
		ref object Status,
		ref object Message)
    {
        string host = "127.0.0.1";
        int port = 6005;

        bool triggerCapture = CaptureButton && !previousCaptureButton;
        previousCaptureButton = CaptureButton;

        bool triggerTransform = TransformButton && !previousTransformButton;
        previousTransformButton = TransformButton;

        if (!ConnectButton)
        {
            isConnected = false;
            triedConnect = false;
            lastStatus = "Disconnected";
            lastMessage = "Connection toggle is off.";
            Status = lastStatus;
            Message = lastMessage;
            return;
        }

        if (ConnectButton && !isConnected && !triedConnect)
        {
            triedConnect = true;

            string response = SendCommand(
                host,
                port,
                "{\"command\":\"ping\"}"
            );

            if (response.StartsWith("ERROR:"))
            {
                isConnected = false;
                lastStatus = "Connection failed";
                lastMessage = response;
            }
            else
            {
                isConnected = true;
                lastStatus = "Connected";
                lastMessage = response;
            }
        }

        if (!isConnected)
        {
            Status = lastStatus;
            Message = lastMessage;
            return;
        }

        if (triggerCapture)
        {
            string session = string.IsNullOrWhiteSpace(SessionName)
                ? "RQC_Capture_Session"
                : SessionName;

            string mode = string.IsNullOrWhiteSpace(Mode)
                ? "all"
                : Mode;

            string capturePayload =
                "{\"command\":\"forward\",\"payload\":{" +
                "\"command\":\"capture\"," +
                "\"session\":\"" + EscapeJson(session) + "\"," +
                "\"camera_index\":0," +
                "\"capture_index\":" + CaptureIndex.ToString() + "," +
                "\"mode\":\"" + EscapeJson(mode) + "\"" +
                "}}";

            string response = SendCommand(host, port, capturePayload);

            if (response.StartsWith("ERROR:"))
            {
                lastStatus = "Capture submit failed";
                lastMessage = response;
            }
            else
            {
                lastStatus = "Capture submitted";
                lastMessage = response;
            }
        }

        if (triggerTransform)
        {
            string session = string.IsNullOrWhiteSpace(SessionName)
                ? "RQC_Capture_Session"
                : SessionName;

            string pipeline = string.IsNullOrWhiteSpace(Pipeline)
                ? "eye_to_base"
                : Pipeline;

            string transformPayload =
                "{\"command\":\"forward\",\"payload\":{" +
                "\"command\":\"transform\"," +
                "\"session\":\"" + EscapeJson(session) + "\"," +
                "\"pipeline\":\"" + EscapeJson(pipeline) + "\"," +
                "\"eye_to_base_index\":" + EyeToBaseIndex.ToString() + "," +
                "\"reference_index\":" + ReferenceIndex.ToString() + "," +
                "\"output_index\":" + OutputIndex.ToString() +
                "}}";

            string response = SendCommand(host, port, transformPayload);

            if (response.StartsWith("ERROR:"))
            {
                lastStatus = "Transform submit failed";
                lastMessage = response;
            }
            else
            {
                lastStatus = "Transform submitted";
                lastMessage = response;
            }
        }

        if (RefreshStatus)
        {
            string statusPayload = "{\"command\":\"get_latest_status\"}";
            string response = SendCommand(host, port, statusPayload);

            if (response.StartsWith("ERROR:"))
            {
                isConnected = false;
                triedConnect = true;
                lastStatus = "Connection lost";
                lastMessage = response;
            }
            else
            {
                string status = ExtractJsonValue(response, "latest_job_status");
                string message = ExtractJsonValue(response, "latest_message");

                lastStatus = string.IsNullOrWhiteSpace(status)
                    ? "Connected"
                    : status;

                lastMessage = string.IsNullOrWhiteSpace(message)
                    ? response
                    : message;
            }
        }

        Status = lastStatus;
        Message = lastMessage;
    }

    private string SendCommand(string host, int port, string command)
    {
        int headerSize = 8;

        try
        {
            using (TcpClient client = new TcpClient())
            {
                IAsyncResult result = client.BeginConnect(host, port, null, null);

                bool success = result.AsyncWaitHandle.WaitOne(
                    TimeSpan.FromMilliseconds(300)
                );

                if (!success)
                    return "ERROR: GH Agent connection timeout.";

                client.EndConnect(result);

                using (NetworkStream stream = client.GetStream())
                {
                    byte[] payload = Encoding.UTF8.GetBytes(command);

                    byte[] header = new byte[headerSize];
                    ulong size = (ulong)payload.Length;

                    for (int i = 0; i < headerSize; i++)
                    {
                        header[headerSize - 1 - i] = (byte)(size & 0xFF);
                        size >>= 8;
                    }

                    stream.Write(header, 0, header.Length);
                    stream.Write(payload, 0, payload.Length);

                    byte[] responseHeader = ReadExact(stream, headerSize);

                    ulong responseSize = 0;
                    for (int i = 0; i < headerSize; i++)
                    {
                        responseSize = (responseSize << 8) + responseHeader[i];
                    }

                    byte[] responsePayload = ReadExact(stream, (int)responseSize);
                    return Encoding.UTF8.GetString(responsePayload);
                }
            }
        }
        catch (Exception e)
        {
            return "ERROR: " + e.Message;
        }
    }

    private byte[] ReadExact(NetworkStream stream, int size)
    {
        byte[] data = new byte[size];
        int offset = 0;

        while (offset < size)
        {
            int read = stream.Read(data, offset, size - offset);

            if (read == 0)
                throw new Exception("Connection closed.");

            offset += read;
        }

        return data;
    }

    private string EscapeJson(string value)
    {
        if (value == null)
            return "";

        return value
            .Replace("\\", "\\\\")
            .Replace("\"", "\\\"");
    }

    private string ExtractJsonValue(string json, string key)
    {
        string pattern = "\"" + key + "\":";
        int start = json.IndexOf(pattern);

        if (start < 0)
            return "";

        start += pattern.Length;

        while (start < json.Length && char.IsWhiteSpace(json[start]))
            start++;

        if (start >= json.Length)
            return "";

        if (json[start] == '"')
        {
            start++;
            int end = json.IndexOf("\"", start);

            if (end < 0)
                return "";

            return json.Substring(start, end - start);
        }
        else
        {
            int end = start;

            while (
                end < json.Length &&
                json[end] != ',' &&
                json[end] != '}')
            {
                end++;
            }

            return json.Substring(start, end - start).Trim();
        }
    }
}
# ---------- end c_script ----------
trigger = Trigger(Interval=1000, TimerInterval=1000, Target=[c_script, c_script_5])  # disabled
panel_10 = Panel(c_script.Status)
panel_11 = Panel(c_script.Message)

# ----
download = Button()
file_types = ValueList({"pointcloud", "image", "json"}, selected="pointcloud")
panel_12 = Panel("{\"command\":\"forward\",\"payload\":{\"command\":\"capture\",\"session\":\"RQC_Capture_Session\",\"camera_index\":0,\"capture_index\":1,\"mode\":\"all\"}}")
panel_13 = Panel("{\"command\":\"ping_python\"}")
panel_14 = Panel("{\"command\":\"forward\",\"payload\":{\"command\":\"capture\"}}")
panel_15 = Panel("{\"command\":\"forward\",\"payload\":{\"command\":\"capture\",\"session\":\"0_GH03\",\"camera_index\":0,\"capture_index\":1,\"mode\":\"all\"}}")

# ---- group: Capture
trigger_2 = Trigger(Interval=1000, TimerInterval=1000, Target=c_script_2)  # disabled
c_script_2 = CSharpScript(
    ConnectButton=Toggle(False),
    CaptureButton=Button(),
    SessionName="0_GH02",
    CaptureIndex="1",
    Mode="all",
    RefreshStatus=Toggle(False))  # -> Status, Message; inputs ConnectButton: Boolean, CaptureButton: Boolean, SessionName: String, CaptureIndex: Int32, Mode: String, RefreshStatus: Boolean
# ---------- c_script_2: C# ----------
// Grasshopper Script Instance
#region Usings
using System;
using System.Text;
using System.Net.Sockets;
using System.Linq;
using System.Collections;
using System.Collections.Generic;
using System.Drawing;

using Rhino;
using Rhino.Geometry;

using Grasshopper;
using Grasshopper.Kernel;
using Grasshopper.Kernel.Data;
using Grasshopper.Kernel.Types;
#endregion

public class Script_Instance : GH_ScriptInstance
{
    private bool previousCaptureButton = false;

    private bool isConnected = false;
    private bool triedConnect = false;

    private string lastStatus = "Disconnected";
    private string lastMessage = "Click Connect first.";

    private void RunScript(
		bool ConnectButton,
		bool CaptureButton,
		string SessionName,
		int CaptureIndex,
		string Mode,
		bool RefreshStatus,
		ref object Status,
		ref object Message)
    {
        string host = "127.0.0.1";
        int port = 6005;

        bool triggerCapture = CaptureButton && !previousCaptureButton;
        previousCaptureButton = CaptureButton;

        if (!ConnectButton)
        {
            isConnected = false;
            triedConnect = false;
            lastStatus = "Disconnected";
            lastMessage = "Connection toggle is off.";
            Status = lastStatus;
            Message = lastMessage;
            return;
        }

        if (ConnectButton && !isConnected && !triedConnect)
        {
            triedConnect = true;

            string response = SendCommand(
                host,
                port,
                "{\"command\":\"ping\"}"
            );

            if (response.StartsWith("ERROR:"))
            {
                isConnected = false;
                lastStatus = "Connection failed";
                lastMessage = response;
            }
            else
            {
                isConnected = true;
                lastStatus = "Connected";
                lastMessage = response;
            }
        }

        if (!isConnected)
        {
            Status = lastStatus;
            Message = lastMessage;
            return;
        }

        if (triggerCapture)
        {
            string session = string.IsNullOrWhiteSpace(SessionName)
                ? "RQC_Capture_Session"
                : SessionName;

            string mode = string.IsNullOrWhiteSpace(Mode)
                ? "all"
                : Mode;

            string capturePayload =
                "{\"command\":\"forward\",\"payload\":{" +
                "\"command\":\"capture\"," +
                "\"session\":\"" + EscapeJson(session) + "\"," +
                "\"camera_index\":0," +
                "\"capture_index\":" + CaptureIndex.ToString() + "," +
                "\"mode\":\"" + EscapeJson(mode) + "\"" +
                "}}";

            string response = SendCommand(host, port, capturePayload);

            if (response.StartsWith("ERROR:"))
            {
                lastStatus = "Capture submit failed";
                lastMessage = response;
            }
            else
            {
                lastStatus = "Capture submitted";
                lastMessage = response;
            }
        }

        if (RefreshStatus)
        {
            string statusPayload = "{\"command\":\"get_latest_status\"}";
            string response = SendCommand(host, port, statusPayload);

            if (response.StartsWith("ERROR:"))
            {
                isConnected = false;
                triedConnect = true;
                lastStatus = "Connection lost";
                lastMessage = response;
            }
            else
            {
                string status = ExtractJsonValue(response, "latest_job_status");
                string message = ExtractJsonValue(response, "latest_message");

                lastStatus = string.IsNullOrWhiteSpace(status)
                    ? "Connected"
                    : status;

                lastMessage = string.IsNullOrWhiteSpace(message)
                    ? response
                    : message;
            }
        }

        Status = lastStatus;
        Message = lastMessage;
    }

    private string SendCommand(string host, int port, string command)
    {
        int headerSize = 8;

        try
        {
            using (TcpClient client = new TcpClient())
            {
                IAsyncResult result = client.BeginConnect(host, port, null, null);

                bool success = result.AsyncWaitHandle.WaitOne(
                    TimeSpan.FromMilliseconds(300)
                );

                if (!success)
                    return "ERROR: GH Agent connection timeout.";

                client.EndConnect(result);

                using (NetworkStream stream = client.GetStream())
                {
                    byte[] payload = Encoding.UTF8.GetBytes(command);

                    byte[] header = new byte[headerSize];
                    ulong size = (ulong)payload.Length;

                    for (int i = 0; i < headerSize; i++)
                    {
                        header[headerSize - 1 - i] = (byte)(size & 0xFF);
                        size >>= 8;
                    }

                    stream.Write(header, 0, header.Length);
                    stream.Write(payload, 0, payload.Length);

                    byte[] responseHeader = ReadExact(stream, headerSize);

                    ulong responseSize = 0;
                    for (int i = 0; i < headerSize; i++)
                    {
                        responseSize = (responseSize << 8) + responseHeader[i];
                    }

                    byte[] responsePayload = ReadExact(stream, (int)responseSize);
                    return Encoding.UTF8.GetString(responsePayload);
                }
            }
        }
        catch (Exception e)
        {
            return "ERROR: " + e.Message;
        }
    }

    private byte[] ReadExact(NetworkStream stream, int size)
    {
        byte[] data = new byte[size];
        int offset = 0;

        while (offset < size)
        {
            int read = stream.Read(data, offset, size - offset);

            if (read == 0)
                throw new Exception("Connection closed.");

            offset += read;
        }

        return data;
    }

    private string EscapeJson(string value)
    {
        if (value == null)
            return "";

        return value
            .Replace("\\", "\\\\")
            .Replace("\"", "\\\"");
    }

    private string ExtractJsonValue(string json, string key)
    {
        string pattern = "\"" + key + "\":";
        int start = json.IndexOf(pattern);

        if (start < 0)
            return "";

        start += pattern.Length;

        while (start < json.Length && char.IsWhiteSpace(json[start]))
            start++;

        if (start >= json.Length)
            return "";

        if (json[start] == '"')
        {
            start++;
            int end = json.IndexOf("\"", start);

            if (end < 0)
                return "";

            return json.Substring(start, end - start);
        }
        else
        {
            int end = start;

            while (
                end < json.Length &&
                json[end] != ',' &&
                json[end] != '}')
            {
                end++;
            }

            return json.Substring(start, end - start).Trim();
        }
    }
}
# ---------- end c_script_2 ----------
panel_16 = Panel(c_script_2.Message)
panel_17 = Panel(c_script_2.Status)

# ---- group: Transform
c_script_3 = CSharpScript(
    ConnectButton=Toggle(False),
    TransformButton=Button(),
    SessionName="EOB_test01",
    Pipeline="eye_to_base",
    EyeToBaseIndex="1",
    ReferenceIndex="2",
    RefreshStatus=Toggle(False))  # -> Status, Message; inputs ConnectButton: Boolean, TransformButton: Boolean, SessionName: String, Pipeline: String, EyeToBaseIndex: Int32, ReferenceIndex: Int32, RefreshStatus: Boolean
# ---------- c_script_3: C# ----------
// Grasshopper Script Instance
#region Usings
using System;
using System.Text;
using System.Net.Sockets;
using System.Linq;
using System.Collections;
using System.Collections.Generic;
using System.Drawing;

using Rhino;
using Rhino.Geometry;

using Grasshopper;
using Grasshopper.Kernel;
using Grasshopper.Kernel.Data;
using Grasshopper.Kernel.Types;
#endregion

public class Script_Instance : GH_ScriptInstance
{
    private bool previousTransformButton = false;

    private bool isConnected = false;
    private bool triedConnect = false;

    private string lastStatus = "Disconnected";
    private string lastMessage = "Click Connect first.";

    private void RunScript(
		bool ConnectButton,
		bool TransformButton,
		string SessionName,
		string Pipeline,
		int EyeToBaseIndex,
		int ReferenceIndex,
		bool RefreshStatus,
		ref object Status,
		ref object Message)
    {
        string host = "127.0.0.1";
        int port = 6005;

        bool triggerTransform = TransformButton && !previousTransformButton;
        previousTransformButton = TransformButton;

        if (!ConnectButton)
        {
            isConnected = false;
            triedConnect = false;
            lastStatus = "Disconnected";
            lastMessage = "Connection toggle is off.";
            Status = lastStatus;
            Message = lastMessage;
            return;
        }

        if (ConnectButton && !isConnected && !triedConnect)
        {
            triedConnect = true;

            string response = SendCommand(
                host,
                port,
                "{\"command\":\"ping\"}"
            );

            if (response.StartsWith("ERROR:"))
            {
                isConnected = false;
                lastStatus = "Connection failed";
                lastMessage = response;
            }
            else
            {
                isConnected = true;
                lastStatus = "Connected";
                lastMessage = response;
            }
        }

        if (!isConnected)
        {
            Status = lastStatus;
            Message = lastMessage;
            return;
        }

        if (triggerTransform)
        {
            string session = string.IsNullOrWhiteSpace(SessionName)
                ? "RQC_Capture_Session"
                : SessionName;

            string pipeline = string.IsNullOrWhiteSpace(Pipeline)
                ? "eye_to_base"
                : Pipeline;

            string transformPayload =
                "{\"command\":\"forward\",\"payload\":{" +
                "\"command\":\"transform\"," +
                "\"session\":\"" + EscapeJson(session) + "\"," +
                "\"pipeline\":\"" + EscapeJson(pipeline) + "\"," +
                "\"eye_to_base_index\":" + EyeToBaseIndex.ToString() + "," +
                "\"reference_index\":" + ReferenceIndex.ToString() +
                "}}";

            string response = SendCommand(host, port, transformPayload);

            if (response.StartsWith("ERROR:"))
            {
                lastStatus = "Transform submit failed";
                lastMessage = response;
            }
            else
            {
                lastStatus = "Transform submitted";
                lastMessage = response;
            }
        }

        if (RefreshStatus)
        {
            string statusPayload = "{\"command\":\"get_latest_status\"}";
            string response = SendCommand(host, port, statusPayload);

            if (response.StartsWith("ERROR:"))
            {
                isConnected = false;
                triedConnect = true;
                lastStatus = "Connection lost";
                lastMessage = response;
            }
            else
            {
                string status = ExtractJsonValue(response, "latest_job_status");
                string message = ExtractJsonValue(response, "latest_message");

                lastStatus = string.IsNullOrWhiteSpace(status)
                    ? "Connected"
                    : status;

                lastMessage = string.IsNullOrWhiteSpace(message)
                    ? response
                    : message;
            }
        }

        Status = lastStatus;
        Message = lastMessage;
    }

    private string SendCommand(string host, int port, string command)
    {
        int headerSize = 8;

        try
        {
            using (TcpClient client = new TcpClient())
            {
                IAsyncResult result = client.BeginConnect(host, port, null, null);

                bool success = result.AsyncWaitHandle.WaitOne(
                    TimeSpan.FromMilliseconds(300)
                );

                if (!success)
                    return "ERROR: GH Agent connection timeout.";

                client.EndConnect(result);

                using (NetworkStream stream = client.GetStream())
                {
                    byte[] payload = Encoding.UTF8.GetBytes(command);

                    byte[] header = new byte[headerSize];
                    ulong size = (ulong)payload.Length;

                    for (int i = 0; i < headerSize; i++)
                    {
                        header[headerSize - 1 - i] = (byte)(size & 0xFF);
                        size >>= 8;
                    }

                    stream.Write(header, 0, header.Length);
                    stream.Write(payload, 0, payload.Length);

                    byte[] responseHeader = ReadExact(stream, headerSize);

                    ulong responseSize = 0;
                    for (int i = 0; i < headerSize; i++)
                    {
                        responseSize = (responseSize << 8) + responseHeader[i];
                    }

                    byte[] responsePayload = ReadExact(stream, (int)responseSize);
                    return Encoding.UTF8.GetString(responsePayload);
                }
            }
        }
        catch (Exception e)
        {
            return "ERROR: " + e.Message;
        }
    }

    private byte[] ReadExact(NetworkStream stream, int size)
    {
        byte[] data = new byte[size];
        int offset = 0;

        while (offset < size)
        {
            int read = stream.Read(data, offset, size - offset);

            if (read == 0)
                throw new Exception("Connection closed.");

            offset += read;
        }

        return data;
    }

    private string EscapeJson(string value)
    {
        if (value == null)
            return "";

        return value
            .Replace("\\", "\\\\")
            .Replace("\"", "\\\"");
    }

    private string ExtractJsonValue(string json, string key)
    {
        string pattern = "\"" + key + "\":";
        int start = json.IndexOf(pattern);

        if (start < 0)
            return "";

        start += pattern.Length;

        while (start < json.Length && char.IsWhiteSpace(json[start]))
            start++;

        if (start >= json.Length)
            return "";

        if (json[start] == '"')
        {
            start++;
            int end = json.IndexOf("\"", start);

            if (end < 0)
                return "";

            return json.Substring(start, end - start);
        }
        else
        {
            int end = start;

            while (
                end < json.Length &&
                json[end] != ',' &&
                json[end] != '}')
            {
                end++;
            }

            return json.Substring(start, end - start).Trim();
        }
    }
}
# ---------- end c_script_3 ----------
trigger_3 = Trigger(Interval=1000, TimerInterval=1000, Target=c_script_3)  # disabled
panel_18 = Panel(c_script_3.Message)
panel_19 = Panel(c_script_3.Status)

# ----
button = Button()
c_script_4 = CSharpScript(Run=Toggle(False), Command=panel_12)  # -> Response; inputs Run: Boolean, Command: String
# ---------- c_script_4: C# ----------
// Grasshopper Script Instance
#region Usings
using System;
using System.Text;
using System.Net.Sockets;
using System.Linq;
using System.Collections;
using System.Collections.Generic;
using System.Drawing;

using Rhino;
using Rhino.Geometry;

using Grasshopper;
using Grasshopper.Kernel;
using Grasshopper.Kernel.Data;
using Grasshopper.Kernel.Types;
#endregion

public class Script_Instance : GH_ScriptInstance
{
    private void RunScript(bool Run, string Command, ref object Response)
    {
        if (!Run)
        {
            Response = "Waiting...";
            return;
        }

        string host = "127.0.0.1";
        int port = 6005;
        int headerSize = 8;

        try
        {
            using (TcpClient client = new TcpClient(host, port))
            using (NetworkStream stream = client.GetStream())
            {
                byte[] payload = Encoding.UTF8.GetBytes(Command);

                byte[] header = new byte[headerSize];
                ulong size = (ulong)payload.Length;

                for (int i = 0; i < headerSize; i++)
                {
                    header[headerSize - 1 - i] = (byte)(size & 0xFF);
                    size >>= 8;
                }

                stream.Write(header, 0, header.Length);
                stream.Write(payload, 0, payload.Length);

                byte[] responseHeader = ReadExact(stream, headerSize);

                ulong responseSize = 0;
                for (int i = 0; i < headerSize; i++)
                {
                    responseSize = (responseSize << 8) + responseHeader[i];
                }

                byte[] responsePayload = ReadExact(stream, (int)responseSize);
                Response = Encoding.UTF8.GetString(responsePayload);
            }
        }
        catch (Exception e)
        {
            Response = "ERROR: " + e.Message;
        }
    }

    private byte[] ReadExact(NetworkStream stream, int size)
    {
        byte[] data = new byte[size];
        int offset = 0;

        while (offset < size)
        {
            int read = stream.Read(data, offset, size - offset);

            if (read == 0)
            {
                throw new Exception("Connection closed.");
            }

            offset += read;
        }

        return data;
    }
}
# ---------- end c_script_4 ----------
c_script_5 = CSharpScript(
    ConnectButton=connect,
    DownloadButton=download,
    SessionName=panel_9,
    OutputIndex=output_index,
    FileTypes=file_types,
    RefreshStatus=refresh_status)  # -> Status, Message, PointCloudPaths, ImagePaths, JsonPaths; inputs ConnectButton: Boolean, DownloadButton: Boolean, SessionName: String, OutputIndex: Int32, FileTypes: String, RefreshStatus: Boolean
# ---------- c_script_5: C# ----------
// Grasshopper Script Instance
#region Usings
using System;
using System.Text;
using System.Net.Sockets;
using System.Linq;
using System.Collections;
using System.Collections.Generic;
using System.Drawing;

using Rhino;
using Rhino.Geometry;

using Grasshopper;
using Grasshopper.Kernel;
using Grasshopper.Kernel.Data;
using Grasshopper.Kernel.Types;
#endregion

public class Script_Instance : GH_ScriptInstance
{
    private bool previousDownloadButton = false;

    private bool isConnected = false;
    private bool triedConnect = false;

    private string lastStatus = "Disconnected";
    private string lastMessage = "Click Connect first.";

    private List<string> lastPointCloudPaths = new List<string>();
    private List<string> lastImagePaths = new List<string>();
    private List<string> lastJsonPaths = new List<string>();

    private void RunScript(
		bool ConnectButton,
		bool DownloadButton,
		string SessionName,
		int OutputIndex,
		string FileTypes,
		bool RefreshStatus,
		ref object Status,
		ref object Message,
		ref object PointCloudPaths,
		ref object ImagePaths,
		ref object JsonPaths)
    {
        string host = "127.0.0.1";
        int port = 6005;

        bool triggerDownload = DownloadButton && !previousDownloadButton;
        previousDownloadButton = DownloadButton;

        if (!ConnectButton)
        {
            isConnected = false;
            triedConnect = false;
            lastStatus = "Disconnected";
            lastMessage = "Connection toggle is off.";
            Status = lastStatus;
            Message = lastMessage;
            PointCloudPaths = lastPointCloudPaths;
            ImagePaths = lastImagePaths;
            JsonPaths = lastJsonPaths;
            return;
        }

        if (ConnectButton && !isConnected && !triedConnect)
        {
            triedConnect = true;

            string response = SendCommand(
                host,
                port,
                "{\"command\":\"ping\"}"
            );

            if (response.StartsWith("ERROR:"))
            {
                isConnected = false;
                lastStatus = "Connection failed";
                lastMessage = response;
            }
            else
            {
                isConnected = true;
                lastStatus = "Connected";
                lastMessage = response;
            }
        }

        if (!isConnected)
        {
            Status = lastStatus;
            Message = lastMessage;
            PointCloudPaths = lastPointCloudPaths;
            ImagePaths = lastImagePaths;
            JsonPaths = lastJsonPaths;
            return;
        }

        if (triggerDownload)
        {
            string session = string.IsNullOrWhiteSpace(SessionName)
                ? "RQC_Capture_Session"
                : SessionName;

            string fileTypesJson = BuildFileTypesArray(FileTypes);

            string downloadPayload =
                "{\"command\":\"downloadable_outputs\"," +
                "\"session\":\"" + EscapeJson(session) + "\"," +
                "\"output_index\":" + OutputIndex.ToString() + "," +
                "\"file_types\":" + fileTypesJson +
                "}";

            string response = SendCommand(host, port, downloadPayload);

            if (response.StartsWith("ERROR:"))
            {
                lastStatus = "Download failed";
                lastMessage = response;
            }
            else
            {
                lastStatus = "Download requested";
                lastMessage = response;
            }
        }

        if (RefreshStatus)
        {
            string statusPayload = "{\"command\":\"get_latest_status\"}";
            string response = SendCommand(host, port, statusPayload);

            if (response.StartsWith("ERROR:"))
            {
                isConnected = false;
                triedConnect = true;
                lastStatus = "Connection lost";
                lastMessage = response;
            }
            else
            {
                string status = ExtractJsonValue(response, "latest_job_status");
                string message = ExtractJsonValue(response, "latest_message");

                lastStatus = string.IsNullOrWhiteSpace(status)
                    ? "Connected"
                    : status;

                lastMessage = string.IsNullOrWhiteSpace(message)
                    ? response
                    : message;

                lastPointCloudPaths = ExtractLocalPathsByCategory(response, "pointclouds");
                lastImagePaths = ExtractLocalPathsByCategory(response, "images");
                lastJsonPaths = ExtractLocalPathsByCategory(response, "json");
            }
        }

        Status = lastStatus;
        Message = lastMessage;
        PointCloudPaths = lastPointCloudPaths;
        ImagePaths = lastImagePaths;
        JsonPaths = lastJsonPaths;
    }

    private string BuildFileTypesArray(string fileTypes)
    {
        if (string.IsNullOrWhiteSpace(fileTypes))
            return "[\"pointcloud\",\"image\",\"json\"]";

        string[] parts = fileTypes.Split(',');

        List<string> cleaned = new List<string>();

        foreach (string part in parts)
        {
            string value = part.Trim().ToLower();

            if (value == "pointcloud" || value == "pointclouds" || value == "pcd" || value == "ply")
                cleaned.Add("\"pointcloud\"");

            else if (value == "image" || value == "images" || value == "img" || value == "png")
                cleaned.Add("\"image\"");

            else if (value == "json")
                cleaned.Add("\"json\"");
        }

        if (cleaned.Count == 0)
            return "[\"pointcloud\",\"image\",\"json\"]";

        return "[" + string.Join(",", cleaned) + "]";
    }

   private List<string> ExtractLocalPathsByCategory(string json, string category)
    {
        HashSet<string> uniquePaths = new HashSet<string>();
        List<string> paths = new List<string>();

        int searchStart = 0;

        while (true)
        {
            int localPathIndex = json.IndexOf("\"local_path\":", searchStart);
            if (localPathIndex < 0)
                break;

            string path = ExtractJsonStringAt(
                json,
                localPathIndex + "\"local_path\":".Length
            );

            if (!string.IsNullOrWhiteSpace(path))
            {
                string normalized = path.Replace("/", "\\").ToLower();
                string categoryFolder = "\\" + category.ToLower() + "\\";

                if (normalized.Contains(categoryFolder))
                {
                    string key = normalized.Trim();

                    if (!uniquePaths.Contains(key))
                    {
                        uniquePaths.Add(key);
                        paths.Add(path);
                    }
                }
            }

            searchStart = localPathIndex + 1;
        }

        return paths;
    }
    

    private string ExtractJsonStringAt(string json, int start)
    {
        while (start < json.Length && char.IsWhiteSpace(json[start]))
            start++;

        if (start >= json.Length || json[start] != '"')
            return "";

        start++;

        StringBuilder sb = new StringBuilder();
        bool escape = false;

        for (int i = start; i < json.Length; i++)
        {
            char c = json[i];

            if (escape)
            {
                if (c == '\\') sb.Append('\\');
                else if (c == '"') sb.Append('"');
                else if (c == 'n') sb.Append('\n');
                else if (c == 'r') sb.Append('\r');
                else if (c == 't') sb.Append('\t');
                else sb.Append(c);

                escape = false;
            }
            else
            {
                if (c == '\\')
                    escape = true;
                else if (c == '"')
                    break;
                else
                    sb.Append(c);
            }
        }

        return sb.ToString();
    }

    private string SendCommand(string host, int port, string command)
    {
        int headerSize = 8;

        try
        {
            using (TcpClient client = new TcpClient())
            {
                IAsyncResult result = client.BeginConnect(host, port, null, null);

                bool success = result.AsyncWaitHandle.WaitOne(
                    TimeSpan.FromMilliseconds(300)
                );

                if (!success)
                    return "ERROR: GH Agent connection timeout.";

                client.EndConnect(result);

                using (NetworkStream stream = client.GetStream())
                {
                    byte[] payload = Encoding.UTF8.GetBytes(command);

                    byte[] header = new byte[headerSize];
                    ulong size = (ulong)payload.Length;

                    for (int i = 0; i < headerSize; i++)
                    {
                        header[headerSize - 1 - i] = (byte)(size & 0xFF);
                        size >>= 8;
                    }

                    stream.Write(header, 0, header.Length);
                    stream.Write(payload, 0, payload.Length);

                    byte[] responseHeader = ReadExact(stream, headerSize);

                    ulong responseSize = 0;
                    for (int i = 0; i < headerSize; i++)
                    {
                        responseSize = (responseSize << 8) + responseHeader[i];
                    }

                    byte[] responsePayload = ReadExact(stream, (int)responseSize);
                    return Encoding.UTF8.GetString(responsePayload);
                }
            }
        }
        catch (Exception e)
        {
            return "ERROR: " + e.Message;
        }
    }

    private byte[] ReadExact(NetworkStream stream, int size)
    {
        byte[] data = new byte[size];
        int offset = 0;

        while (offset < size)
        {
            int read = stream.Read(data, offset, size - offset);

            if (read == 0)
                throw new Exception("Connection closed.");

            offset += read;
        }

        return data;
    }

    private string EscapeJson(string value)
    {
        if (value == null)
            return "";

        return value
            .Replace("\\", "\\\\")
            .Replace("\"", "\\\"");
    }

    private string ExtractJsonValue(string json, string key)
    {
        string pattern = "\"" + key + "\":";
        int start = json.IndexOf(pattern);

        if (start < 0)
            return "";

        start += pattern.Length;

        while (start < json.Length && char.IsWhiteSpace(json[start]))
            start++;

        if (start >= json.Length)
            return "";

        if (json[start] == '"')
        {
            start++;
            int end = json.IndexOf("\"", start);

            if (end < 0)
                return "";

            return json.Substring(start, end - start);
        }
        else
        {
            int end = start;

            while (
                end < json.Length &&
                json[end] != ',' &&
                json[end] != '}')
            {
                end++;
            }

            return json.Substring(start, end - start).Trim();
        }
    }
}
# ---------- end c_script_5 ----------
panel_20 = Panel(c_script_4)
panel_21 = Panel(c_script_5.Status)
panel_22 = Panel(c_script_5.Message)
path = FilePath(c_script_5.PointCloudPaths)
import = ImportContent(FilePath=path)  # -> Objects, Layers, Linetypes, HatchPatterns, AnnotationStyles, Materials, BlockDefinitions
